# Grasshopper definition shotpic complete for 20241119.gh (Grasshopper 1.0.7)
# plug-ins: ghgl

show_pic = Button()
clik_to_shot = Button()
multiplication = Multiplication(A="1.5", B="2160")
multiplication_2 = Multiplication(A="1.5", B="4096")
输入 = Panel("C:\Users\sikai.chen\Desktop\newpic\01")
c_script = CSharpScript(
    nextImage=show_pic,
    screenshotWidth=multiplication_2,
    screenshotHeight=multiplication,
    With_alph=Toggle(True),
    takeScreenshot=clik_to_shot,
    filePath=输入)  # -> output, image; inputs nextImage: Boolean, screenshotWidth: Int32, screenshotHeight: Int32, With_alph: Boolean, takeScreenshot: Boolean, filePath: String
# ---------- c_script: C# usings ----------
using System.Drawing;
using System.IO;
using System.Linq;

using Rhino.Display;
# ---------- c_script: C# ----------
    // 找到最后一个"/"的位置
    int lastSlashIndex = filePath.LastIndexOf('\\');
    // 截取最后一个"/"前的部分
    string folderPath = filePath.Substring(0, lastSlashIndex);

    // 检查是否目录存在
    if (!Directory.Exists(folderPath))
    {
      output = "文件夹不存在！";
      return;
    }
    // 获取文件夹中的所有图像文件
    string[] files = Directory.GetFiles(folderPath, "*.png"); // 可以根据需要增加其他格式


    if (files.Length > 0)
    {
      imageFiles = files.ToList(); // 更新图片列表
      if (currentIndex >= imageFiles.Count) currentIndex = 0; // 确保索引有效
    }
    else
    {
      output = "该文件夹中没有图像文件！";
      image = null; // 清空图像输出

    }

    // 点击按钮切换图片
    if (nextImage)
    {
      currentIndex = (currentIndex + 1) % imageFiles.Count; // 更新索引
    }

    // 更新图片路径
    if (imageFiles.Count > 0)
    {
      image = imageFiles[currentIndex]; // 返回当前图像路径
    }
    // 判断是否需要截图
    if (takeScreenshot)
    {
      // 获取当前活动视图
      var view = RhinoDoc.ActiveDoc.Views.ActiveView;

      // 检查视图是否存在
      if (view != null)
      {
        ViewCapture view_capture = new ViewCapture();
        view_capture.Width = screenshotWidth;
        view_capture.Height = screenshotHeight;
        view_capture.ScaleScreenItems = false;
        view_capture.DrawAxes = false;
        view_capture.DrawGrid = false;
        view_capture.DrawGridAxes = false;
        view_capture.TransparentBackground = With_alph;

        Bitmap bitmap = view_capture.CaptureToBitmap(view);


        try
        {
          // 使用时间戳来创建唯一文件名
          string uniqueFilePath = System.IO.Path.Combine(
            System.IO.Path.GetDirectoryName(filePath),
            System.IO.Path.GetFileNameWithoutExtension(filePath) + "_" + DateTime.Now.ToString("yyyyMMdd_HHmmss") + ".png");

          // 保存截图
          bitmap.Save(uniqueFilePath, System.Drawing.Imaging.ImageFormat.Png);
          output = "截图已保存到: " + uniqueFilePath;
        }
        catch (Exception e)
        {
          output = "错误: " + e.Message; // 捕获并报告错误
        }
        finally
        {
          bitmap.Dispose(); // 释放 Bitmap 资源
        }
      }
      else
      {
        output = "没有活动视图可供截图"; // 如果没有活动视图
      }
    }
    else
    {

      output = "显示:" + imageFiles[currentIndex] + "\n截图未被请求"; // 如果不截图
    }
# ---------- c_script: C# additional code ----------
  private List<string> imageFiles = new List<string>();
  private int currentIndex = -1;
# ---------- end c_script ----------
image_resource = ImageResource(c_script.image)
输出 = Panel(c_script.output)
mesh = Mesh()
path = FilePath("D:\KK final output\KK\U盘\Maya&材质预设\material ball pro\final ball\maya file\建模材质球预设00.png")
gl_mesh = GLMeshShader(
    M=mesh,
    U_texture=path,
    DepthTestingEnabled=True,
    DepthWritingEnabled=True,
    DrawMode=4,
    FragmentShader="""#version 330

uniform vec3 _lightDirection[4];
uniform mat3 _worldToCameraNormal;
uniform sampler2D u_texture;

in  vec3 normal;
in vec2 texcoord;
in vec3 v_normal;
out vec4 fragment_color;

void main() {
  
  vec2 uv = v_normal.xy * 0.5 + 0.5;
  uv.y = 1.0 - uv.y;
  fragment_color = texture2D(u_texture, uv);
}""",
    GLShader=(0, 2, 0),
    PreviewSortOrder=5,
    VertexShader="""#version 330

layout(location = 0) in vec3 _meshVertex;
layout(location = 1) in vec3 _meshNormal;
layout(location = 2) in vec2 _meshTextureCoordinate;

uniform mat4 _worldToClip;
uniform mat3 _worldToCameraNormal;
out vec3 normal;
out vec3 v_normal;
out vec2 texcoord;

void main() {
  normal = _meshNormal;
  gl_Position = _worldToClip * vec4(_meshVertex , 1.0);
  v_normal = _worldToCameraNormal * normal;
  texcoord = _meshTextureCoordinate;
}""",
    glLineWidth=3,
    glPointSize=8)  # -> Color, Depth
