# Grasshopper definition shotpic complete.gh (Grasshopper 1.0.7)

panel = Panel("C:\Users\sikai.chen\Desktop\newpic\01_20241109_101351.png")  # disabled
clik_to_shot = Button()
brep = Brep(<brep referenced from the Rhino model>)  # disabled
show_pic = Button()
c_script = CSharpScript(geometry=brep, imagePath=panel)  # -> output; inputs geometry: GeometryBase, imagePath: String; disabled
# ---------- c_script: C# usings ----------
using System.Drawing;
using System.IO;
# ---------- c_script: C# ----------
    if (geometry == null)
    {
      output = "请输入有效的几何体。";
      return;
    }

    // 检查是否提供有效的图像路径
    if (string.IsNullOrEmpty(imagePath) || !File.Exists(imagePath))
    {
      output = "无效的图片路径。";
      return;
    }

    // 获取输入几何体的边界框并进行预览
    var bbox = geometry.GetBoundingBox(true);

    // 加载图像
    Bitmap bitmap;
    try
    {
      bitmap = new Bitmap(imagePath);
    }
    catch (Exception ex)
    {
      output = "加载图片失败: " + ex.Message;
      return;
    }

    // 在Grasshopper中实现自定义预览
    // 这里通过Override方法生成自定义材质
    var displayMesh = geometry.DuplicateMesh(); // 复制输入几何体
    var material = new Grasshopper.Kernel.Graphics.GH_Material(); // 创建材质

    material.SetBitmapTexture(bitmap); // 使用图片设置材质
    displayMesh.SetMaterial(material); // 将材质应用于几何体

    // 设置输出
    output = displayMesh;
# ---------- end c_script ----------
输入 = Panel("C:\Users\sikai.chen\Desktop\newpic\01")
c_script_2 = CSharpScript(
    nextImage=show_pic,
    screenshotWidth="4096",
    screenshotHeight="4096",
    With_alph=Toggle(True),
    takeScreenshot=clik_to_shot,
    filePath=输入)  # -> output, image; inputs nextImage: Boolean, screenshotWidth: Int32, screenshotHeight: Int32, With_alph: Boolean, takeScreenshot: Boolean, filePath: String
# ---------- c_script_2: C# usings ----------
using System.Drawing;
using System.IO;
using System.Linq;

using Rhino.Display;
# ---------- c_script_2: C# ----------
    // 找到最后一个"/"的位置
    int lastSlashIndex = filePath.LastIndexOf('\\');
    // 截取最后一个"/"前的部分
    string folderPath = filePath.Substring(0, lastSlashIndex);

    // 检查是否目录存在
    if (!Directory.Exists(folderPath))
    {
      output = "文件夹不存在！";
      return;
    }
    // 获取文件夹中的所有图像文件
    string[] files = Directory.GetFiles(folderPath, "*.png"); // 可以根据需要增加其他格式


    if (files.Length > 0)
    {
      imageFiles = files.ToList(); // 更新图片列表
      if (currentIndex >= imageFiles.Count) currentIndex = 0; // 确保索引有效
    }
    else
    {
      output = "该文件夹中没有图像文件！";
      image = null; // 清空图像输出

    }

    // 点击按钮切换图片
    if (nextImage)
    {
      currentIndex = (currentIndex + 1) % imageFiles.Count; // 更新索引
    }

    // 更新图片路径
    if (imageFiles.Count > 0)
    {
      image = imageFiles[currentIndex]; // 返回当前图像路径
    }
    // 判断是否需要截图
    if (takeScreenshot)
    {
      // 获取当前活动视图
      var view = RhinoDoc.ActiveDoc.Views.ActiveView;

      // 检查视图是否存在
      if (view != null)
      {
        ViewCapture view_capture = new ViewCapture();
        view_capture.Width = screenshotWidth;
        view_capture.Height = screenshotHeight;
        view_capture.ScaleScreenItems = false;
        view_capture.DrawAxes = false;
        view_capture.DrawGrid = false;
        view_capture.DrawGridAxes = false;
        view_capture.TransparentBackground = With_alph;

        Bitmap bitmap = view_capture.CaptureToBitmap(view);


        try
        {
          // 使用时间戳来创建唯一文件名
          string uniqueFilePath = System.IO.Path.Combine(
            System.IO.Path.GetDirectoryName(filePath),
            System.IO.Path.GetFileNameWithoutExtension(filePath) + "_" + DateTime.Now.ToString("yyyyMMdd_HHmmss") + ".png");

          // 保存截图
          bitmap.Save(uniqueFilePath, System.Drawing.Imaging.ImageFormat.Png);
          output = "截图已保存到: " + uniqueFilePath;
        }
        catch (Exception e)
        {
          output = "错误: " + e.Message; // 捕获并报告错误
        }
        finally
        {
          bitmap.Dispose(); // 释放 Bitmap 资源
        }
      }
      else
      {
        output = "没有活动视图可供截图"; // 如果没有活动视图
      }
    }
    else
    {

      output = "显示:" + imageFiles[currentIndex] + "\n截图未被请求"; // 如果不截图
    }
# ---------- c_script_2: C# additional code ----------
  private List<string> imageFiles = new List<string>();
  private int currentIndex = -1;
# ---------- end c_script_2 ----------
image_resource = ImageResource(c_script_2.image)
输出 = Panel(c_script_2.output)
