# Grasshopper definition shotpic.gh (Grasshopper 1.0.7)

clik_to_shot = Button()
show_pic = Button()
path = FilePath("C:\Users\sikai.chen\Desktop\texture\text")
c_script = CSharpScript(nextImage=show_pic, takeScreenshot=clik_to_shot, filePath=path)  # -> output, image; inputs nextImage: Boolean, takeScreenshot: Boolean, filePath: String
# ---------- c_script: C# usings ----------
using System.Drawing;
using System.IO;
using System.Linq;
//using System.Drawing;
using Rhino.DocObjects;
using Grasshopper.Kernel.Parameters;
# ---------- c_script: C# ----------
    // 找到最后一个"/"的位置
    int lastSlashIndex = filePath.LastIndexOf('\\');
    // 截取最后一个"/"前的部分
    string folderPath = filePath.Substring(0, lastSlashIndex);

    // 检查是否目录存在
    if (!Directory.Exists(folderPath))
    {
      output = "文件夹不存在！";
      return;
    }
    // 获取文件夹中的所有图像文件
    string[] files = Directory.GetFiles(folderPath, "*.png"); // 可以根据需要增加其他格式


    if (files.Length > 0)
    {
      imageFiles = files.ToList(); // 更新图片列表
      if (currentIndex >= imageFiles.Count) currentIndex = 0; // 确保索引有效
    }
    else
    {
      output = "该文件夹中没有图像文件！";
      image = null; // 清空图像输出
      return;
    }

    // 点击按钮切换图片
    if (nextImage)
    {
      currentIndex = (currentIndex + 1) % imageFiles.Count; // 更新索引
    }

    // 更新图片路径
    if (imageFiles.Count > 0)
    {
      image = imageFiles[currentIndex]; // 返回当前图像路径
    }
    // 判断是否需要截图
    if (takeScreenshot)
    {
      // 获取当前活动视图
      var view = RhinoDoc.ActiveDoc.Views.ActiveView;

      // 检查视图是否存在
      if (view != null)
      {
        // 截图
        Bitmap bitmap = view.CaptureToBitmap();

        try
        {
          // 使用时间戳来创建唯一文件名
          string uniqueFilePath = System.IO.Path.Combine(
            folderPath,
            System.IO.Path.GetFileNameWithoutExtension(filePath) + "_" + DateTime.Now.ToString("yyyyMMdd_HHmmss") + ".png");

          // 保存截图
          bitmap.Save(uniqueFilePath, System.Drawing.Imaging.ImageFormat.Png);
          output = "截图已保存到: " + uniqueFilePath;
        }
        catch (Exception e)
        {
          output = "错误: " + e.Message; // 捕获并报告错误
        }
      }
      else
      {
        output = "没有活动视图可供截图"; // 如果没有活动视图
      }
    }
    else
    {
      output = "截图未被请求"; // 如果不截图
    }
# ---------- c_script: C# additional code ----------
  private List<string> imageFiles = new List<string>();
  private int currentIndex = -1;
# ---------- end c_script ----------
image_resource = ImageResource(c_script.image)
