# Grasshopper definition super display material.gh (Grasshopper 1.0.7)
# plug-ins: ghgl

brep = Brep(<brep referenced from the Rhino model>)
mesh = MeshBrep(
    Brep=brep,
    Settings={GridMaxCount=0, GridMinCount=16, JaggedSeams=False, MaxEdgeLength=0, MinEdgeLength=0.0001, MinTolerance=0, Refine=True, RefineAngle=0, RelativeTolerance=0.65, SimplePlanes=True, Tolerance=0})
argb = SplitARGB(Colour=ColourSwatch(SwatchColor=RGB(217, 217, 217)))  # -> Alpha, Red, Green, Blue
path = FilePath("D:\KK final output\KK\U盘\Maya&材质预设\material ball pro\final ball\maya file\ceramic_lightbulb.png")
path_2 = FilePath("D:\KK final output\KK\U盘\Maya&材质预设\material ball pro\final ball\maya file\建模材质球预设00_白模.png")
pt = ConstructPoint(XCoordinate=argb.Red, YCoordinate=argb.Green, ZCoordinate=argb.Blue)
panel = Panel(pt)
gl_mesh = GLMeshShader(
    M=mesh,
    U_texture1=path,
    U_texture2=path_2,
    U_mix1=Slider(0.7, range=0..1),
    U_mix2=Slider(0.5, range=0..1),
    U_color=pt,
    DepthTestingEnabled=True,
    DepthWritingEnabled=True,
    DrawMode=4,
    FragmentShader="""#version 330

uniform vec3 _lightDirection[4];
uniform mat3 _worldToCameraNormal;
uniform sampler2D u_texture1;
uniform sampler2D u_texture2;
uniform float u_mix1; 
uniform float u_mix2; 
uniform vec3 u_color;

in  vec3 normal;
in vec2 texcoord;
in vec3 v_normal;
out vec4 fragment_color;

void main() {
  
  vec2 uv = v_normal.xy * 0.5 + 0.5;
  uv.y = 1.0 - uv.y;
  
    vec4 color1 = texture2D(u_texture1, uv);
    vec4 color2 = texture2D(u_texture2, uv);
    
    vec4 colormix1 = mix(color1, color2, u_mix1);
    vec4 colormix2 = mix(vec4(u_color,1.0),colormix1, u_mix2);
  
  
   fragment_color = colormix2;
  
}""",
    GLShader=(0, 2, 0),
    PreviewSortOrder=5,
    VertexShader="""#version 330

layout(location = 0) in vec3 _meshVertex;
layout(location = 1) in vec3 _meshNormal;
layout(location = 2) in vec2 _meshTextureCoordinate;

uniform mat4 _worldToClip;
uniform mat3 _worldToCameraNormal;
out vec3 normal;
out vec3 v_normal;
out vec2 texcoord;

void main() {
  normal = _meshNormal;
  gl_Position = _worldToClip * vec4(_meshVertex , 1.0);
  v_normal = _worldToCameraNormal * normal;
  texcoord = _meshTextureCoordinate;
}""",
    glLineWidth=3,
    glPointSize=8)  # -> Color, Depth
