# Grasshopper definition super ranbowdisplay material (2).gh (Grasshopper 1.0.7)
# plug-ins: ghgl

sph = Sphere(Base=PlaneXY(0, 0, 0), Radius=1)
list = ValueList({"正片叠底(Multiplay)": 0, "叠加(Overlay)": 1, "屏幕(Screen)": 2, "混合(Blend)": 3}, selected="正片叠底(Multiplay)")
smooth = SettingsQuality()
argb = SplitARGB(Colour=ColourSwatch(SwatchColor=RGB(255, 255, 255)))  # -> Alpha, Red, Green, Blue
mesh = MeshBrep(Brep=sph, Settings=smooth)
path = FilePath("D:\KK final output\KK\U盘\Maya&材质预设\material ball pro\final ball\maya file\建模材质球预设00_白模.png")
path_2 = FilePath("D:\KK final output\KK\U盘\Maya&材质预设\material ball pro\final ball\maya file\ceramic_lightbulb.png")
pt = ConstructPoint(XCoordinate=argb.Red, YCoordinate=argb.Green, ZCoordinate=argb.Blue)

# ---- group: Multiplay
gl_mesh = GLMeshShader(
    M=mesh,
    U_texture1=path,
    U_texture2=path_2,
    U_mix1=Slider(0.3, range=0..1),
    U_color=pt,
    U_mix2=Slider(1, range=0..1),
    DepthTestingEnabled=True,
    DepthWritingEnabled=True,
    DrawMode=4,
    FragmentShader="""#version 330

uniform vec3 _lightDirection[4];
uniform mat3 _worldToCameraNormal;
uniform sampler2D u_texture1;
uniform sampler2D u_texture2;
uniform float u_mix1; 
uniform float u_mix2; 
uniform vec3 u_color;
uniform vec4 colormix1;

in  vec3 normal;
in vec2 texcoord;
in vec3 v_normal;
out vec4 fragment_color;

vec4 multiplyBlend(vec4 baseColor, vec4 blendColor,float factor) {
    return mix(baseColor, baseColor * blendColor, factor);
}

void main() {
  
  vec2 uv = v_normal.xy * 0.5 + 0.5;
  uv.y = 1.0 - uv.y;
  
    vec4 color1 = texture2D(u_texture1, uv);
    vec4 color2 = texture2D(u_texture2, uv);
    
   // if(BlendMode == 0){
        vec4 colormix1 = multiplyBlend(color1, color2, u_mix1);
       // }
       
    //if(BlendMode == 3){
        //vec4 colormix1 = mix(color1, color2, u_mix1);
       // }
       
    
    vec4 colormix2 = mix(vec4(u_color,1.0),colormix1, u_mix2);
  
  
   fragment_color = colormix2;
  
}""",
    GLShader=(0, 2, 0),
    PreviewSortOrder=5,
    VertexShader="""#version 330

layout(location = 0) in vec3 _meshVertex;
layout(location = 1) in vec3 _meshNormal;
layout(location = 2) in vec2 _meshTextureCoordinate;

uniform mat4 _worldToClip;
uniform mat3 _worldToCameraNormal;
out vec3 normal;
out vec3 v_normal;
out vec2 texcoord;

void main() {
  normal = _meshNormal;
  gl_Position = _worldToClip * vec4(_meshVertex , 1.0);
  v_normal = _worldToCameraNormal * normal;
  texcoord = _meshTextureCoordinate;
}""",
    glLineWidth=3,
    glPointSize=8)  # -> Color, Depth

# ----
panel = Panel("队列集体赋予不同颜色的matcap")
