# Grasshopper definition super ranbowdisplay material need debug.gh (Grasshopper 1.0.7)
# plug-ins: ghgl

subd = SubD(<subd referenced from the Rhino model>)
argb = SplitARGB(Colour=ColourSwatch(SwatchColor=RGB(255, 0, 0)))  # -> Alpha, Red, Green, Blue
meshsubd = MeshFromSubD(SubD=subd, Density="2")
list = ValueList({"正片叠底(Multiplay)": 0, "叠加(Overlay)": 1, "屏幕(Screen)": 2, "混合(Blend)": 3}, selected="正片叠底(Multiplay)")
pt = ConstructPoint(XCoordinate=argb.Red, YCoordinate=argb.Green, ZCoordinate=argb.Blue)
path = FilePath("D:\KK final output\KK\U盘\KK金属材质\全部\kspace needle.png")
path_2 = FilePath("D:\KK final output\KK\U盘\KK金属材质\全部\space needle.png")
gl_mesh = GLMeshShader(
    M=meshsubd,
    U_texture1=path_2,
    U_texture2=path,
    BlendMode=list,
    U_mix1=Slider(0.6, range=0..1),
    U_color=pt,
    U_mix2=Slider(1, range=0..1),
    U_factor=Slider(1, range=0..1),
    DepthTestingEnabled=True,
    DepthWritingEnabled=True,
    DrawMode=4,
    FragmentShader="""#version 330

uniform vec3 _lightDirection[4];
uniform mat3 _worldToCameraNormal;
uniform sampler2D u_texture1;
uniform sampler2D u_texture2;
uniform float u_mix1; 
uniform float u_mix2; 
uniform float u_factor; 
uniform vec3 u_color;
uniform int BlendMode; 
uniform vec4 colormix1;

in  vec3 normal;
in vec2 texcoord;
in vec3 v_normal;
out vec4 fragment_color;

vec4 multiplyBlend(vec4 baseColor, vec4 blendColor) {
    return baseColor * blendColor;
}

void main() {
  
  vec2 uv = v_normal.xy * 0.5 + 0.5;
  uv.y = 1.0 - uv.y;
  
    vec4 color1 = texture2D(u_texture1, uv);
    vec4 color2 = texture2D(u_texture2, uv);
    
    if(BlendMode == 0){
        vec4 colormix1 = multiplyBlend(color1, color2);
        }
       
    if(BlendMode == 3){
        vec4 colormix1 = mix(color1, color2, u_mix1);
        }
       
    
    vec4 colormix2 = mix(vec4(u_color,1.0),colormix1, u_mix2);
  
  
   fragment_color = colormix2*u_factor;
  
}""",
    GLShader=(0, 2, 0),
    PreviewSortOrder=5,
    VertexShader="""#version 330

layout(location = 0) in vec3 _meshVertex;
layout(location = 1) in vec3 _meshNormal;
layout(location = 2) in vec2 _meshTextureCoordinate;

uniform mat4 _worldToClip;
uniform mat3 _worldToCameraNormal;
out vec3 normal;
out vec3 v_normal;
out vec2 texcoord;

void main() {
  normal = _meshNormal;
  gl_Position = _worldToClip * vec4(_meshVertex , 1.0);
  v_normal = _worldToCameraNormal * normal;
  texcoord = _meshTextureCoordinate;
}""",
    glLineWidth=3,
    glPointSize=8)  # -> Color, Depth
