# Grasshopper definition unnamed.gh (Grasshopper 1.0.7)
# plug-ins: Pufferfish

cir = Circle(Plane=PlaneXY(0, 0, 0), Radius=expr("X/2", "78"))
Z = UnitZ(Factor="160")
pt = ConstructPoint(XCoordinate=0, YCoordinate=0, ZCoordinate=0)
crv = Curve([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])
extr = Extrude(Base=cir, Direction=Z)
dim = Dimensions(Surface=extr)  # -> UDimension, VDimension
pt_2 = ConstructPoint(XCoordinate=dim.UDimension, YCoordinate=dim.VDimension, ZCoordinate=0)
rec_2pt = Rectangle2Pt(Plane=pt, PointA=pt, PointB=pt_2, Radius=0)  # -> Rectangle, Length
boundary = BoundarySurfaces(Edges=rec_2pt.Rectangle)
area = Area(Geometry=boundary)  # -> Area, Centroid
rotate = Rotate(Geometry=crv, Angle=3.141592654, Plane=area.Centroid)  # -> Geometry, Transform
join = JoinCurves(Curves=flatten([rotate.Geometry, crv]), Preserve=False)
midpt = CurveMiddle(Curve=join)
lng = ListLength(List=midpt)
pdecon = Deconstruct(Point=midpt)  # -> XComponent, YComponent, ZComponent
series = Series(Start=0, Step=1, Count=lng)
sort = SortList(Keys=pdecon.YComponent, ValuesA=series)  # -> Keys, ValuesA
item = ListItem(List=join, Index=sort.ValuesA, Wrap=True)
rebcrv = RebuildCurve(Curve=item, Count="20", Degree="5", EndTangents=False)
midpt_2 = CurveMiddle(Curve=rebcrv)
intcrv = Interpolate(Vertices=midpt_2, Degree=3, Periodic=False, KnotStyle=1)  # -> Curve, Length, Domain
end = EndPoints(Curve=rebcrv)  # -> Start, End
crv_cp = CurveClosestPoint(Point=end.Start, Curve=intcrv.Curve)  # -> Point, Parameter, Distance
vec2pt = Vector2Pt(PointA=end.Start, PointB=crv_cp.Point, Unitize=False)  # -> Vector, Length
pdecon_2 = Deconstruct(Point=vec2pt.Vector)  # -> XComponent, YComponent, ZComponent
smaller = SmallerThan(FirstNumber=pdecon_2.XComponent, SecondNumber="0")  # -> SmallerThan, OrEqualTo
dispatch = Dispatch(List=rebcrv, DispatchPattern=smaller.SmallerThan)  # -> ListA, ListB
flip = FlipCurve(Curve=dispatch.ListA)  # -> Curve, Flag
div = DivideDomain(Domain=Domain(0, 1), Count=Slider(48, range=0..100))
dedomain = DeconstructDomain(Domain=div)  # -> Start, End
div_2 = DivideDomain(Domain=Domain(0, 1), Count=Slider(24, range=0..100))
dedomain_2 = DeconstructDomain(Domain=div_2)  # -> Start, End
weave = Weave(Pattern=smaller.SmallerThan, Stream0=dispatch.ListB, Stream1=flip.Curve, NullGaps=False)
merge = Merge(Data1="0", Data2=dedomain.End)  # -> flatten(Result)
merge_2 = Merge(Data1="0", Data2=dedomain_2.End)  # -> flatten(Result)
twnconcrvs = TweenConsecutiveCurves(Curves=weave, Factor=merge, Loopback=False, InterpolationType=0, Refit=0, PointSample=0)
twnconcrvs_2 = TweenConsecutiveCurves(Curves=weave, Factor=merge_2, Loopback=False, InterpolationType=0, Refit=0, PointSample=0)
xz = XZPlane(Origin=area.Centroid)
ccx = CurveCurve(CurveA=rec_2pt.Rectangle, CurveB=twnconcrvs_2)  # -> Points, ParamsA, ParamsB
mirror = Mirror(Geometry=twnconcrvs, Plane=xz)  # -> Geometry, Transform
shatter = Shatter(Curve=graft(twnconcrvs_2), Parameters=ccx.ParamsB)
item_2 = ListItem(List=shatter, Index=0, Wrap=True)  # -> Item, flatten(Item1)
explode = Explode(Curve=rec_2pt.Rectangle, Recursive=True)  # -> Segments, Vertices
item_3 = ListItem(List=explode.Segments, Index=0, Wrap=True)  # -> Item, Item1, Item2, Item3
crv_2 = Curve(item_2.Item1)
lng_2 = ListLength(List=crv_2)
series_2 = Series(Start=0, Step=1, Count=lng_2)
len = Length(Curve=crv_2)
sort_2 = SortList(Keys=len, ValuesA=series_2)  # -> Keys, ValuesA
panel = Panel("80")
split = SplitList(List=sort_2.ValuesA, Index=Slider(93, range=85..100))  # -> ListA, ListB
item_4 = ListItem(List=crv_2, Index=split.ListB, Wrap=True)  # -> graft(Item)
ccx_2 = CurveCurve(CurveA=mirror.Geometry, CurveB=item_4)  # -> Points, ParamsA, ParamsB
sporph = Sporph(G=flatten(ccx_2.Points), S0=boundary, P0="0,0,0", S1=extr, P1="0,0,0", R=False)
panel_2 = Panel(sort_2.Keys)
arrpolar = PolarArray(Geometry=sporph, Plane=PlaneXY(0, 0, 0), Count="6", Angle=6.283185307)  # -> Geometry, Transform
item_5 = ListItem(List=arrpolar.Geometry, Index=0, Wrap=True)  # -> flatten(Item), flatten(Item1), flatten(Item2), flatten(Item3), flatten(Item4), flatten(Item5)
group = Group(Objects=item_5.Item2)
group_2 = Group(Objects=item_5.Item3)
group_3 = Group(Objects=item_5.Item)
group_4 = Group(Objects=item_5.Item1)
group_5 = Group(Objects=item_5.Item4)
group_6 = Group(Objects=item_5.Item5)
merge_3 = Merge(Data1=group_3, Data2=group_4, Data3=group, Data4=group_2, Data5=group_5, Data6=group_6)  # -> flatten(Result)
lng_3 = ListLength(List=merge_3)
cluster = Cluster(relay=lng_3)
remap = RemapNumbers(Value=cluster, Source=Domain(0, 1), Target=Domain(0, 1))  # -> Mapped, Clipped
graph = GraphMapper(
    remap.Mapped,
    x0=0,
    x1=1,
    y0=0,
    y1=1,
    container_name="折线",
    pt=[Point(0, 1, 0), Point(0.5761276484, 1, 0), Point(0.7497523427, 0, 0), Point(1, 0, 0)])
remap_2 = RemapNumbers(Value=graph, Source=Domain(0, 1), Target="5 to 45")  # -> Mapped, Clipped
rotate_2 = Rotate(Geometry=merge_3, Angle=degrees(remap_2.Mapped), Plane=PlaneXY(0, 0, 0))  # -> Geometry, Transform
item_6 = ListItem(List=rotate_2.Geometry, Index=0, Wrap=True)  # -> Item, Item1, Item2, Item3, Item4, Item5, Item6
geo = Geometry([item_6.Item2, item_6.Item3, item_6.Item4, item_6.Item5, item_6.Item, item_6.Item1, item_6.Item6])
lng_4 = ListLength(List=geo)
ungroup = Ungroup(Group=geo)
cluster_2 = Cluster(relay=lng_4)
sporph_2 = Sporph(G=ungroup, S0=extr, P0="0,0,0", S1=boundary, P1="0,0,0", R=False)  # -> flatten(Geometry)
crv_3 = Curve(item_3.Item1)
crv_4 = Curve(item_3.Item3)
crv_cp_2 = CurveClosestPoint(Point=sporph_2, Curve=crv_3)  # -> Point, Parameter, Distance
crv_cp_3 = CurveClosestPoint(Point=sporph_2, Curve=crv_3)  # -> Point, Parameter, Distance
crv_cp_4 = CurveClosestPoint(Point=sporph_2, Curve=crv_3)  # -> Point, Parameter, Distance
crv_cp_5 = CurveClosestPoint(Point=sporph_2, Curve=crv_4)  # -> Point, Parameter, Distance
bnd = Bounds(Numbers=crv_cp_2.Distance)
bnd_2 = Bounds(Numbers=crv_cp_3.Distance)
bnd_3 = Bounds(Numbers=crv_cp_4.Distance)
bnd_4 = Bounds(Numbers=crv_cp_5.Distance)
remap_3 = RemapNumbers(Value=crv_cp_2.Distance, Source=bnd, Target=Domain(0, 1))  # -> Mapped, Clipped
remap_4 = RemapNumbers(Value=crv_cp_3.Distance, Source=bnd_2, Target=Domain(0, 1))  # -> Mapped, Clipped
remap_5 = RemapNumbers(Value=crv_cp_4.Distance, Source=bnd_3, Target=Domain(0, 1))  # -> Mapped, Clipped
remap_6 = RemapNumbers(Value=crv_cp_5.Distance, Source=bnd_4, Target=Domain(0, 1))  # -> Mapped, Clipped
graph_2 = GraphMapper(remap_3.Mapped, x0=0, x1=1, y0=0, y1=1, Cx=0.3044557571, Cy=0.6972382069, container_name="Conic")
graph_3 = GraphMapper(remap_4.Mapped, x0=0, x1=1, y0=0, y1=1, Cx=0.3044557571, Cy=0.6972382069, container_name="Conic")
graph_4 = GraphMapper(remap_5.Mapped, x0=0, x1=1, y0=0, y1=1, Cx=0.3044557571, Cy=0.6972382069, container_name="Conic")
graph_5 = GraphMapper(remap_6.Mapped, x0=0, x1=1, y0=0, y1=1, Cx=0.3044557571, Cy=0.6972382069, container_name="Conic")
crv_cp_6 = CurveClosestPoint(Point=sporph_2, Curve=crv_3)  # -> Point, Parameter, Distance
crv_cp_7 = CurveClosestPoint(Point=sporph_2, Curve=crv_4)  # -> Point, Parameter, Distance
bnd_5 = Bounds(Numbers=crv_cp_6.Distance)
bnd_6 = Bounds(Numbers=crv_cp_7.Distance)
remap_7 = RemapNumbers(Value=graph_5, Source=Domain(0, 1), Target="0.5 to 1.5")  # -> Mapped, Clipped
remap_8 = RemapNumbers(Value=graph_2, Source=Domain(0, 1), Target="0.15 TO 0")  # -> Mapped, Clipped
remap_9 = RemapNumbers(Value=graph_3, Source=Domain(0, 1), Target="0 TO 0.15")  # -> Mapped, Clipped
remap_10 = RemapNumbers(Value=graph_4, Source=Domain(0, 1), Target="0.2 TO 1.5")  # -> Mapped, Clipped
remap_11 = RemapNumbers(Value=crv_cp_6.Distance, Source=bnd_5, Target=Domain(0, 1))  # -> Mapped, Clipped
remap_12 = RemapNumbers(Value=crv_cp_7.Distance, Source=bnd_6, Target=Domain(0, 1))  # -> Mapped, Clipped
multiplication = Multiplication(A=remap_7.Mapped, B=remap_10.Mapped)
addition = Addition(A=remap_9.Mapped, B=remap_8.Mapped)
graph_6 = GraphMapper(remap_12.Mapped, x0=0, x1=1, y0=0, y1=1, Cx=0.3044557571, Cy=0.6972382069, container_name="Conic")
graph_7 = GraphMapper(remap_11.Mapped, x0=0, x1=1, y0=0, y1=1, Cx=0.3044557571, Cy=0.6972382069, container_name="Conic")
remap_13 = RemapNumbers(Value=graph_6, Source=Domain(0, 1), Target="0 to 60")  # -> Mapped, Clipped
remap_14 = RemapNumbers(Value=graph_7, Source=Domain(0, 1), Target="0 TO 1")  # -> Mapped, Clipped
polygon = Polygon(Plane=sporph_2, Radius=multiplication, Segments="3", FilletRadius=addition)  # -> Polygon, Length
multiplication_2 = Multiplication(A=remap_13.Mapped, B=remap_14.Mapped)
rotate_3 = Rotate(Geometry=polygon.Polygon, Angle=degrees(multiplication_2), Plane=sporph_2)  # -> Geometry, Transform
Z_2 = UnitZ(Factor=remap_14.Mapped)
move = Move(Geometry=rotate_3.Geometry, Motion=expr("-x*0.1", Z_2))  # -> Geometry, Transform
boundary_2 = BoundarySurfaces(Edges=graft(move.Geometry))  # -> flatten(Surfaces)
partition = PartitionList(List=boundary_2, Size="709")
panel_3 = Panel(geo)
group_7 = Group(Objects=partition)  # -> flatten(Group)
gradient = Gradient(
    LowerLimit=0,
    UpperLimit=1,
    Parameter=cluster_2,
    stops=[0: RGB(234, 38, 0), 0.25: RGB(234, 126, 0), 0.5: RGB(254, 244, 84), 0.75: RGB(173, 203, 249), 1: RGB(75, 107, 169)])
preview = CustomPreview(Geometry=extr, Material=ColourSwatch(SwatchColor=RGB(255, 255, 255)))
preview_2 = CustomPreview(Geometry=group_7, Material=gradient)

# ==== cluster Cluster
relay = ClusterInput()
div = DivideDomain(Domain=Domain(0, 1), Count=relay)
dedomain = DeconstructDomain(Domain=div)  # -> Start, End
merge = Merge(Data1="0", Data2=dedomain.End)  # -> flatten(Result)
relay_2 = ClusterOutput(merge)
