# Grasshopper definition 灰色显示物体.gh (Grasshopper 1.0.7)

brep = Brep(<brep referenced from the Rhino model>)
mesh = MeshBrep(
    Brep=brep,
    Settings={GridMaxCount=0, GridMinCount=16, JaggedSeams=False, MaxEdgeLength=0, MinEdgeLength=0.0001, MinTolerance=0, Refine=True, RefineAngle=0, RelativeTolerance=0.65, SimplePlanes=True, Tolerance=0})
c_script = CSharpScript(x=mesh)  # inputs x: Mesh
# ---------- c_script: C# usings ----------
using Rhino.Display;
using System.Drawing;
# ---------- c_script: C# ----------
    _mesh = x; // 将输入的网格存储在私有变量中
# ---------- c_script: C# additional code ----------
  private Mesh _mesh; // 用于存储输入的网格

  //Return a BoundingBox that contains all the geometry you are about to draw.
  public override BoundingBox ClippingBox
  {
    get
    {
      return BoundingBox.Empty;
    }
  }

  //Draw all meshes in this method.
  public override void DrawViewportMeshes(IGH_PreviewArgs args)
  {
    if (_mesh != null)
    {
      // 使用黑色渲染网格
      args.Display.DrawMeshShaded(_mesh, new DisplayMaterial(Color.Silver));
    }
  }
  // Draw all wires and points in this method.
  public override void DrawViewportWires(IGH_PreviewArgs args)
  {
    if (_mesh != null)
    {
      // 使用蓝色绘制网格线框
      args.Display.DrawMeshWires(_mesh, Color.Silver);
    }
  }
# ---------- end c_script ----------
