# Grasshopper definition 边缘控制网络基础方法.gh (Grasshopper 1.0.7)

number_slider = Slider(100, range=0..100)
pt = ConstructPoint(XCoordinate=0, YCoordinate=0, ZCoordinate=0)
sqgrid = Square(Plane=pt, Size=1, ExtentX=number_slider, ExtentY=number_slider)  # -> Cells, Points
crv = Curve(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)
area = Area(Geometry=sqgrid.Cells)  # -> Area, Centroid
incurve = PointInCurve(Point=area.Centroid, Curve=crv)  # -> Relationship, Point
equals = Equality(FirstNumber="2", SecondNumber=incurve.Relationship)  # -> Equality, Inequality
dispatch = Dispatch(List=sqgrid.Cells, DispatchPattern=equals.Equality)  # -> ListA, ListB
crv_2 = Curve(flatten(dispatch.ListA))
rint = RegionIntersection(CurvesA=crv_2, CurvesB=crv)  # -> flatten(Result)
area_2 = Area(Geometry=rint)  # -> Area, Centroid
area_3 = Area(Geometry=crv_2)  # -> Area, Centroid
bnd = Bounds(Numbers=area_2.Area)
crv_cp = CurveClosestPoint(Point=area_3.Centroid, Curve=crv)  # -> Point, Parameter, Distance
remap = RemapNumbers(Value=area_2.Area, Source=bnd, Target=Domain(0, 1))  # -> Mapped, Clipped
bnd_2 = Bounds(Numbers=crv_cp.Distance)
graph = GraphMapper(
    remap.Mapped,
    x0=0,
    x1=1,
    y0=0,
    y1=1,
    container_name="折线",
    pt=[Point(0, 0.7013977766, 0), Point(0.1184051707, 0.7004552484, 0), Point(0.8747861385, 0.2270151973, 0), Point(1, 0.2270923257, 0)])
remap_2 = RemapNumbers(Value=crv_cp.Distance, Source=bnd_2, Target=Domain(0, 1))  # -> Mapped, Clipped
graph_2 = GraphMapper(
    remap_2.Mapped,
    x0=0,
    x1=1,
    y0=0,
    y1=1,
    container_name="内插点",
    pt=[Point(0, 0.7135748863, 0), Point(0.1711794436, 0.8553311229, 0), Point(0.4394875467, 0.9385641217, 0), Point(0.8713780642, 0.9918852448, 0), Point(1, 1, 0)])
remap_3 = RemapNumbers(Value=graph, Source=Domain(0, 1), Target="0.35 to 0.1")  # -> Mapped, Clipped
multiplication = Multiplication(A=remap_3.Mapped, B=graph_2)
cir = Circle(Plane=area_3.Centroid, Radius=multiplication)
