# Grasshopper definition 黄金阵列(中心对称).gh (Grasshopper 1.0.7)

sqrt = SquareRoot(Value="5")
addition = Addition(A="1", B=sqrt)
cir = Circle(Plane=PlaneXY(0, 0, 0), Radius=1)
division = Division(A=addition, B="2")
subtraction = Subtraction(A=division, B="1")
shatter = Shatter(Curve=reparameterize(cir), Parameters=flatten(["0", subtraction]))
panel = Panel("""0
1""")
len = Length(Curve=shatter)
sort = SortList(Keys=len, ValuesA=panel)  # -> Keys, ValuesA
item = ListItem(List=sort.ValuesA, Index=0, Wrap=True)
item_2 = ListItem(List=shatter, Index=item, Wrap=True)
end = EndPoints(Curve=item_2)  # -> Start, End
angle = Angle(VectorA=end.Start, VectorB=end.End)  # -> Angle, Reflex
deg = Degrees(Radians=angle.Angle)
panel_2 = Panel(deg)

sqrt_2 = SquareRoot(Value="5")
subtraction_2 = Subtraction(A="3", B=sqrt_2)
multiplication = Multiplication(A="180", B=subtraction_2)
panel_3 = Panel(multiplication)

数字滑块 = Slider(103, range=0..1000)
数字滑块_2 = Slider(0, range=0..1)
number_slider = Slider(6, range=0..10)
division_2 = Division(A="137.507764", B="360")
系列 = 系列(起始=division_2, 步长=1, 数量=数字滑块)
division_3 = Division(A="137.507764", B=number_slider)
sqrt_3 = 平方根(值=系列)
multiplication_2 = Multiplication(A=sqrt_3, B=Slider(1, range=0..10))
系列_2 = 系列(起始=数字滑块_2, 步长=division_3, 数量=数字滑块)
pt = 构造点(X坐标=multiplication_2, Y坐标=0, Z坐标=0)
旋转 = 旋转(几何体=pt, 角度=degrees(系列_2), 平面=PlaneXY(0, 0, 0))  # -> 几何体, 变换
arrpolar = PolarArray(Geometry=旋转.几何体, Plane=PlaneXY(0, 0, 0), Count=number_slider, Angle=6.283185307)  # -> Geometry, Transform
item_3 = ListItem(List=arrpolar.Geometry, Index=0, Wrap=True)
